# Grasshopper definition 01_parametricTruss.gh (Grasshopper 1.0.7)
# plug-ins: sof_gh_sofistik_rhino, LunchBox, Phoenix

io = IO(
    SofistikDocumentProperties_VersionMajor="2020",
    SofistikDocumentProperties_VersionMinor="8",
    SofistikDocumentProperties_VersionName="Rhino-Interface")
io_2 = IO(
    SofistikDocumentProperties_VersionMajor="2020",
    SofistikDocumentProperties_VersionMinor="8",
    SofistikDocumentProperties_VersionName="Rhino-Interface")

# ----
# Parameters
number_slider = Slider(16, range=0..100)
load_mn = Slider(-0.42, range=-1..1)
list = ValueList({"Blank": 1, "Forces": 2, "Utilization": 3, "Reuse New": 4, "Mass": 5, "Environmental Impact": 6}, selected="Forces")
toggle = BooleanToggle(False)
list_2 = ValueList({"MinStructureMass": 1, "MinStockMass": 2, "MinWaste": 3, "MinLCA": 4}, selected="MinLCA")
height = Slider(3, range=-10..10)
number_slider_2 = Slider(12, range=0..100)

# ----
# Geometry
X = UnitX(Factor=1)
pt = Point(Point(5, 0, 5))
line = LineSDL(Start=pt, Direction=X, Length=number_slider)
Z = UnitZ(Factor=height)
move = Move(Geometry=line, Motion=Z)  # -> Geometry, Transform
truss = _2DTruss(CurveA=line, CurveB=move.Geometry, Divisions=Slider(4, range=0..10), TrussToggle=0)  # -> PrimaryLines, BraceLines, VerticalLines, StructureNodes
panel = Panel("""0
-2""")
end = EndPoints(Curve=truss.VerticalLines)  # -> Start, End
item = ListItem(List=truss.StructureNodes, Index=panel, Wrap=True)
difference = SetDifference(SetA=truss.StructureNodes, SetB=item)
crv = Curve([truss.PrimaryLines, truss.BraceLines, truss.VerticalLines])
item_2 = ListItem(List=item, Index=0, Wrap=True)  # -> Item, Item1

# ----
# Structure
number_slider_3 = Slider(40, range=0..100)
Z_2 = UnitZ(Factor=load_mn)
number_slider_4 = Slider(0.7, range=0..1)
# Phoenix
steel = Steel(
    D_kg_m3=7850,
    YoungsModulus=210000,
    PoissonRatio=0.3,
    TensionStrength=235,
    CompressionStrength=235,
    MaterialSafetyFactor=1,
    MaterialSafetyFactorForStability=1.1)
cs = CircularSection(Diameter_mm=number_slider_3)
Y = UnitY(Factor=1)
pl = Pointload(Point=end.End, Forces_MN=Z_2, ScaleLoad=1)
toggle_2 = BooleanToggle(False)
barext_truss = BarExtended(Lines=crv, Material=steel, CrossSection=cs, Normal=Y, BucklingType=0)
loadcase = LoadCase(Name="LC1", PointLoads=pl, SelfWeightFactor=1)
sp = Support(Location=item_2.Item, FixTX=True, FixTY=True, FixTZ=True, ScaleSupport=number_slider_4)
sp_2 = Support(Location=difference, FixTX=toggle_2, FixTY=True, FixTZ=toggle_2, ScaleSupport=number_slider_4)
sp_3 = Support(Location=item_2.Item1, FixTX=Toggle(False), FixTY=True, FixTZ=True, ScaleSupport=number_slider_4)
S = Structure(Members=barext_truss, Supports=[sp, sp_2, sp_3], LoadCases=loadcase)

# ----
# Stock
steel_2 = Steel(
    D_kg_m3=7850,
    YoungsModulus=210000,
    PoissonRatio=0.3,
    TensionStrength=235,
    CompressionStrength=235,
    MaterialSafetyFactor=1,
    MaterialSafetyFactorForStability=1.1)
panel_2 = Panel("""30
40""")
panel_3 = Panel("""50
70
100
120
150
200""")
cs_2 = CircularSection(Diameter_mm=panel_2)
cs_3 = CircularSection(Diameter_mm=panel_3)
newelement = NewElement(Material=steel_2, CrossSection=cs_2, Name="new")
reusedelement = ReusedElement(
    Material=steel_2,
    CrossSection=cs_3,
    Length=Slider(12, range=0..100),
    AmountOfElements=Slider(5, range=0..100),
    ElementsCanBeCut=True,
    Name="reused")
stock = Stock(ElementsReuseAndNew=[reusedelement, newelement], OrderElements=Slider(1, range=0..2))

# ----
# MILP
toggle_3 = BooleanToggle(True)
dscooptions = DSCOOptions(
    Optimizer=0,
    MaxTime=2147483647,
    Logging=True,
    LogFormName="MILP Optimization Log",
    Compatibility=True,
    SelfWeight=False,
    CuttingStock=toggle_3)
dscopt = DiscreteStockConstrainedOptimization(Structure=S, Stock=stock, Objective=list_2, LoadCaseNames="LC1", DSCOOptions=dscooptions, Run=Toggle(False))  # -> Structure, ObjectiveValue, BarAreas, BarNormalForces, LowerBounds, UpperBounds, Stock, Runtime

# ----
# Best-Fit
panel_4 = Panel("LC1")
bf = BestFit(Structure=S, Stock=stock, Objective=list_2, LoadCases=panel_4, PromoteFirstPart=False, Iterations=1, RunFEA=False)  # -> Structure, Stock, Runtime

# ----
# Results - Best-Fit
pt_2 = Point(Point(30, 0, 0))
list_3 = ValueList({"Full Stock Blank": 0, "Full Stock": 1, "Used Stock": 2}, selected="Used Stock")
xy = XYPlane(Origin=pt_2)
disp_stock = DisplayStock(
    Structure=bf.Structure,
    Stock=bf.Stock,
    Plane=xy,
    SpacingVector=Vector(1, 1, 0),
    StockType=list_3,
    ResultsType=list,
    LoadCase=panel_4)  # -> StockElements, UsedElements
disp_struct = DisplayStructure(Structure=bf.Structure, DisplayResultsType=list, LoadCase=panel_4, DisplacementScale=number_slider_2)
disp_res = DisplayResults(Stucture=bf.Structure, ShowResultsOnStructure=toggle, LoadCase=panel_4)  # -> OptimizationResults, Utilization, NormalForces
panel_5 = Panel(disp_res.OptimizationResults)

# ----
# Results - MILP
pt_3 = Point(Point(30, 0, 0))
list_4 = ValueList({"Full Stock Blank": 0, "Full Stock": 1, "Used Stock": 2}, selected="Used Stock")
xy_2 = XYPlane(Origin=pt_3)
disp_stock_2 = DisplayStock(
    Structure=dscopt.Structure,
    Stock=dscopt.Stock,
    Plane=xy_2,
    SpacingVector=Vector(1, 1, 0),
    StockType=list_4,
    ResultsType=list,
    LoadCase="LC1")  # -> StockElements, UsedElements
disp_struct_2 = DisplayStructure(Structure=dscopt.Structure, DisplayResultsType=list, LoadCase="LC1", DisplacementScale=number_slider_2)
disp_res_2 = DisplayResults(Stucture=dscopt.Structure, ShowResultsOnStructure=toggle, LoadCase=panel_4)  # -> OptimizationResults, Utilization, NormalForces
panel_6 = Panel(disp_res_2.OptimizationResults)
