# Grasshopper definition 02_parametricSpaceTruss.gh (Grasshopper 1.0.7)
# plug-ins: sof_gh_sofistik_rhino, LunchBox, Phoenix

io = IO(
    SofistikDocumentProperties_VersionMajor="2020",
    SofistikDocumentProperties_VersionMinor="8",
    SofistikDocumentProperties_VersionName="Rhino-Interface")

# ----
# Parameters
lc_number = Slider(1, range=1..2)
list = ValueList({"MinStructureMass": 1, "MinStockMass": 2, "MinWaste": 3, "MinLCA": 4}, selected="MinLCA")
list_2 = ValueList({"Blank": 1, "Forces": 2, "Utilization": 3, "Reuse New": 4, "Mass": 5, "Environmental Impact": 6}, selected="Reuse New")
displacement_scale = Slider(0, range=0..100)

v_lift = Slider(-5, range=-5..5)
u_lift = Slider(5, range=-5..5)

load_mn_lc2 = Slider(-0.03, range=-0.1..0.1)
load_mn_lc1 = Slider(-0.03, range=-0.1..0.1)

number_slider = Slider(20, range=0..20)
number_slider_2 = Slider(10, range=0..20)

# ----
# Geometry
pt = Point(Point(0, 0, 0))
rectangle = Rectangle(Plane=pt, XSize=number_slider, YSize=number_slider_2, Radius=0)  # -> Rectangle, Length
multiplication = Multiplication(A=number_slider, B=Slider(0.75, range=0..1))
multiplication_2 = Multiplication(A=number_slider_2, B=Slider(0.75, range=0..1))
multiplication_3 = Multiplication(A=number_slider, B=Slider(0.25, range=0..1))
multiplication_4 = Multiplication(A=number_slider_2, B=Slider(0.25, range=0..1))
srf = Surface(rectangle.Rectangle)
number_slider_3 = Slider(3, range=0..10)
number_slider_4 = Slider(2, range=0..10)
pt_2 = ConstructPoint(XCoordinate=multiplication_3, YCoordinate=multiplication_4, ZCoordinate=0)
pt_3 = ConstructPoint(XCoordinate=multiplication, YCoordinate=multiplication_4, ZCoordinate=0)
pt_4 = ConstructPoint(XCoordinate=multiplication_3, YCoordinate=multiplication_2, ZCoordinate=0)
pt_5 = ConstructPoint(XCoordinate=multiplication, YCoordinate=multiplication_2, ZCoordinate=0)
rebuildsrf = RebuildSurface(Surface=srf, UDegree=number_slider_4, VDegree=number_slider_4, UNumber=number_slider_3, VNumber=number_slider_3)
pt_6 = Point([pt_2, pt_3, pt_5, pt_4])
srfpt = SurfacePoints(Surface=rebuildsrf)  # -> Points, Weights, Greville, UCount, VCount
points = PointList(Points=srfpt.Points, Size="1")
panel = Panel("""3
4
5""")
panel_2 = Panel("""1
4
7""")
item = ListItem(List=srfpt.Points, Index=panel, Wrap=True)
item_2 = ListItem(List=srfpt.Points, Index=panel_2, Wrap=True)
Z = UnitZ(Factor=u_lift)
Z_2 = UnitZ(Factor=v_lift)
lng = ListLength(List=panel)
lng_2 = ListLength(List=panel_2)
dup = DuplicateData(Data=Z, Number=lng, Order=True)
dup_2 = DuplicateData(Data=Z_2, Number=lng_2, Order=True)
pdeform = PointDeform(Geometry=rebuildsrf, Points=[item, item_2], Motion=[dup, dup_2])
spacetruss_1 = SpaceTrussStructure1(Surface=pdeform, UDivisions=Slider(8, range=0..10), VDivisions=Slider(4, range=0..10), TrussDepth=Slider(1, range=0..10))  # -> LinesA, LinesB, Web, Nodes
end = EndPoints(Curve=spacetruss_1.LinesA)  # -> Start, End
end_2 = EndPoints(Curve=spacetruss_1.Web)  # -> Start, End
points_2 = PointList(Points=spacetruss_1.Nodes, Size="1")
intersection = SetIntersection(SetA=flatten([end.End, end.Start]), SetB=flatten([end_2.End, end_2.Start]))
cp = ClosestPoint(Point=pt_6, Cloud=spacetruss_1.Nodes)  # -> ClosestPoint, CPIndex, Distance

# ----
# Members
panel_3 = Panel("355")
steel = Steel(
    D_kg_m3=7850,
    YoungsModulus=210000,
    PoissonRatio=0.3,
    TensionStrength=panel_3,
    CompressionStrength=panel_3,
    MaterialSafetyFactor=1,
    MaterialSafetyFactorForStability=1.1)
genericsection = GenericSection(A_mm2=2500, Iy_mm4=520833, Iz_mm4=520833, Wy_mm3=20833, Wz_mm3=20833, It_mm3=881250, Wt_mm3=20833)
crv = Curve(flatten([spacetruss_1.LinesA, spacetruss_1.LinesB, spacetruss_1.Web]))
bar_truss = Bar(Lines=crv, Material=steel, CrossSection=genericsection, Normal=Vector(0, 0, 1))

# ----
# new
panel_4 = Panel("""3.2
3.2
3.2
4
3.2
4
3.2
4
5
6.3
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""")
panel_5 = Panel("""21.3
26.9
33.7
33.7
42.4
42.4
48.3
48.3
48.3
48.3
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""")
steel_2 = Steel(
    D_kg_m3=7850,
    YoungsModulus=210000,
    PoissonRatio=0.3,
    TensionStrength="235",
    CompressionStrength="235",
    MaterialSafetyFactor=1,
    MaterialSafetyFactorForStability=1.1)
chs = CircularHollowSection(Diameter_mm=panel_5, WallThickness_mm=panel_4)
newelement = NewElement(Material=steel_2, CrossSection=chs, Name="new")

# ----
# reused
panel_6 = Panel("""235
235
235
235
235
235
235
235
235
235
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""")
panel_7 = Panel("""0.276
0.282
0.287
0.302
0.305
0.308
0.358
0.369
0.506
0.52
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""")
panel_8 = Panel("""40
40
40
40
40
40
40
40
40
40
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""")
panel_9 = Panel("""4
4
4
4
4
4
4
4
4
4
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""")
steel_3 = Steel(
    D_kg_m3=7850,
    YoungsModulus=210000,
    PoissonRatio=0.3,
    TensionStrength=panel_6,
    CompressionStrength=panel_6,
    MaterialSafetyFactor=1,
    MaterialSafetyFactorForStability=1.1)
L = LSection(Height_mm=panel_8, Width_mm=panel_8, Thickness_mm=panel_9)
panel_10 = Panel("""58
58
58
58
58
58
116
116
58
116
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""")
reuseelementgroup = ReuseElementGroup(
    Material=steel_3,
    CrossSection=L,
    Length=panel_7,
    AmountOfElements=panel_10,
    ElementsCanBeCut=Toggle(True),
    Name="reused")

# ----
# Supports
number_slider_5 = Slider(0.4, range=0..1)
pt_7 = Point(cp.ClosestPoint)
sp = Support(Location=pt_7, FixTX=True, FixTY=True, FixTZ=True, ScaleSupport=number_slider_5)

# ----
# Stock
number_slider_6 = Slider(1, range=0..10)
stock = Stock(ElementsReuseAndNew=[newelement, reuseelementgroup], OrderElements=number_slider_6)

# ----
# LoadCase 1 & 2
number_slider_7 = Slider(0.5, range=0..1)
Z_3 = UnitZ(Factor=load_mn_lc1)
Y = UnitY(Factor=load_mn_lc2)
pt_8 = Point(intersection)
pt_9 = Point(intersection)
pl = Pointload(Point=pt_9, Forces=Y, ScaleLoad=Slider(0.5, range=0..1))
loadcase = LoadCase(Name="LC2", PointLoads=pl, SelfWeightFactor=1)

pl_2 = Pointload(Point=pt_8, Forces_MN=Z_3, ScaleLoad=number_slider_7)

loadcase_2 = LoadCase(Name="LC1", PointLoads=pl_2, SelfWeightFactor=1)

# ----
# Structure
S = Structure(Members=bar_truss, Supports=sp, LoadCases=[loadcase_2, loadcase])

# ----
# Best-Fit
number_slider_8 = Slider(5, range=0..10)
bf = BestFit(
    Structure=S,
    Stock=stock,
    Objective=list,
    LoadCases="all",
    PromoteFirstPart=Toggle(False),
    Iterations=number_slider_8,
    RunFEA=Toggle(True))  # -> Structure, Stock, Runtime

# ----
# Phoenix
# results
# max utilization
# max diplacement [cm]
panel_11 = Panel("LC")
pt_10 = Point(Point(26.79935125, 18.39280048, 0))
list_3 = ValueList({"Full Stock Blank": 0, "Full Stock": 1, "Used Stock": 2}, selected="Used Stock")
concat = Concatenate(FragmentA=panel_11, FragmentB=lc_number)
xy = XYPlane(Origin=pt_10)
disp_stock = DisplayStock(
    Structure=bf.Structure,
    Stock=bf.Stock,
    Plane=xy,
    SpacingVector=Vector(1, 1, 0),
    StockType=list_3,
    ResultsType=list_2,
    LoadCase=concat)  # -> StockElements, UsedElements
disp_struct = DisplayStructure(Structure=bf.Structure, DisplayResultsType=list_2, LoadCase=concat, DisplacementScale=displacement_scale)
disp_res = DisplayResults(Stucture=bf.Structure, ShowResultsOnStructure=Toggle(False), LoadCase=concat)  # -> OptimizationResults, Utilization, NormalForces
sort = SortList(Keys=disp_res.Utilization)  # -> Keys, ValuesA
decstr = DeconstructStructure(Structure=bf.Structure)  # -> Member, Nodes, Supports, LoadCases
panel_12 = Panel(disp_res.OptimizationResults)
rev = ReverseList(List=sort.Keys)
decnod = DeconstructNodes(Nodes=decstr.Nodes)  # -> Points, DOFs, Displacements, Loads
panel_13 = Panel(rev)
item_3 = ListItem(List=decnod.Displacements, Index=0, Wrap=True)  # -> Item, Item1, Item2
vec = VectorXYZ(XComponent=item_3.Item, YComponent=item_3.Item1, ZComponent=item_3.Item2)  # -> Vector, Length
vlen = VectorLength(Vector=vec.Vector)  # -> flatten(Length)
sort_2 = SortList(Keys=vlen)  # -> Keys, ValuesA
rev_2 = ReverseList(List=sort_2.Keys)
item_4 = ListItem(List=rev_2, Index=0, Wrap=True)
multiplication_5 = Multiplication(A=item_4, B="100")
panel_14 = Panel(multiplication_5)
