# Grasshopper definition 03_topologyOptimization.gh (Grasshopper 1.0.7)
# plug-ins: sof_gh_sofistik_rhino, LunchBox, Cardinal

io = IO(
    SofistikDocumentProperties_VersionMajor="2020",
    SofistikDocumentProperties_VersionMinor="8",
    SofistikDocumentProperties_VersionName="Rhino-Interface")

# ----
# Parameters
number_slider = Slider(20, range=0..20)

# ----
# Supports
# Loads
pt = Point(Point(0, 4, 0))
pt_2 = Point(Point(0, 7, 0))
pt_3 = Point(Point(20, 5, 0))

# ----
# Geometry
pt_4 = Point(Point(0, 0, 0))
rectangle = Rectangle(Plane=pt_4, XSize=number_slider, YSize=Slider(10, range=0..20), Radius=0)  # -> Rectangle, Length
number_slider_2 = Slider(3, range=0..10)
number_slider_3 = Slider(2, range=0..10)
rebuildsrf = RebuildSurface(
    Surface=rectangle.Rectangle,
    UDegree=number_slider_3,
    VDegree=number_slider_3,
    UNumber=number_slider_2,
    VNumber=number_slider_2)
gridbraced2d = BracedGrid2DStructure(Surface=rebuildsrf, UDivisions=Slider(20, range=0..20), VDivisions=Slider(10, range=0..20))  # -> PrimaryLines, BraceLines, StructureNodes

# ----
# Ground Structure
cp = ClosestPoint(Point=pt_2, Cloud=gridbraced2d.StructureNodes)  # -> ClosestPoint, CPIndex, Distance
cp_2 = ClosestPoint(Point=pt, Cloud=gridbraced2d.StructureNodes)  # -> ClosestPoint, CPIndex, Distance
cp_3 = ClosestPoint(Point=pt_3, Cloud=gridbraced2d.StructureNodes)  # -> ClosestPoint, CPIndex, Distance
Y = UnitY(Factor=Slider(-1, range=-10..10))
pl = Pointload(Point=cp_3.ClosestPoint, Forces_MN=Y, ScaleLoad=1)
number_slider_4 = Slider(0.4, range=0..1)
# Phoenix
steel = Steel(
    D_kg_m3=7850,
    YoungsModulus=210000,
    PoissonRatio=0.3,
    TensionStrength=235,
    CompressionStrength=235,
    MaterialSafetyFactor=1,
    MaterialSafetyFactorForStability=1.1)
toggle = BooleanToggle(False)
cs = CircularSection(Diameter_mm=100)
difference = SetDifference(SetA=gridbraced2d.StructureNodes, SetB=[cp.ClosestPoint, cp_2.ClosestPoint])
bar_truss = Bar(Lines=[gridbraced2d.PrimaryLines, gridbraced2d.BraceLines], Material=steel, CrossSection=cs, Normal=Vector(0, 0, 1))
loadcase = LoadCase(Name="LC1", PointLoads=pl, SelfWeightFactor=1)
sp = Support(Location=[cp.ClosestPoint, cp_2.ClosestPoint], FixTX=True, FixTY=True, FixTZ=True, ScaleSupport=number_slider_4)
sp_2 = Support(Location=difference, FixTX=toggle, FixTY=toggle, FixTZ=True, ScaleSupport=number_slider_4)
S = Structure(Members=bar_truss, Supports=[sp_2, sp], LoadCases=loadcase)

# ----
# Optimization
cttopt = ContinuousTopologyOptimization_Component(Structure=S, LoadCaseNames="all")  # -> Structure, StructureMass, flatten(BarAreas), flatten(BarNormalForces)

# ----
# Results
decstr = DeconstructStructure(Structure=cttopt.Structure)  # -> Member, Nodes, Supports, LoadCases
c_script = CSharpScript(Areas=cttopt.BarAreas)  # -> activeAreas, activeIndices; inputs Areas: list of Double
# ---------- c_script: C# ----------
    List<double> activeLines = new List<double>();
    List<int> indices = new List<int>();
    int k = 0;

    for(int i = 0; i < Areas.Count;++i)
    {
      if(Areas[i] > 0.00000000001)
      {
        activeLines.Add(Areas[i]);
        indices.Add(k);
      }
      ++k;
    }

    activeAreas = activeLines;
    activeIndices = indices;
# ---------- end c_script ----------
decmem = DeconstructMembers(Members=decstr.Member)  # -> Lines, CrossSections, Material
scale_factor = Slider(10, range=0..100)
item = ListItem(List=cttopt.BarNormalForces, Index=c_script.activeIndices, Wrap=True)
item_2 = ListItem(List=decmem.Lines, Index=c_script.activeIndices, Wrap=True)
multiplication = Multiplication(A=c_script.activeAreas, B=scale_factor)
pipe = Pipe(Curve=item_2, Radius=multiplication, Caps=Slider(2, range=0..2))  # -> flatten(Pipe)
c_script_2 = CSharpScript(Forces=item, Pipes=pipe)  # -> tensionPipes, compressionPipes; inputs Forces: list of Double, Pipes: list of Brep
# ---------- c_script_2: C# ----------
    List<Brep> blue = new List<Brep>();
    List<Brep> red = new List<Brep>();

    for(int i = 0; i < Forces.Count; ++i)
    {
      if(Forces[i] > 0)
      {
        red.Add(Pipes[i]);
      }
      else if (Forces[i] < 0)
      {
        blue.Add(Pipes[i]);
      }
    }

    tensionPipes = red;
    compressionPipes = blue;
# ---------- end c_script_2 ----------
preview = CustomPreview(Geometry=c_script_2.compressionPipes, Material=ColourSwatch(SwatchColor=RGB(0, 72, 255)))
preview_2 = CustomPreview(Geometry=c_script_2.tensionPipes, Material=ColourSwatch(SwatchColor=RGB(255, 0, 0)))
