# Grasshopper definition p3d_examples.gh (Grasshopper 1.0.7)
# plug-ins: CEM_Build_Topology_2.0, CEM_Deviation_2.0, CEM_Load_2.0, CEM_Support_2.0, CEM_Trail_2.0, CEM_Calculate_Structure_2.0, Phoenix3D

pt = Point([Point(15, 0, 10), Point(25, 0, 10), Point(20, 0, 5)])
pt_2 = Point(Point(20, 0, 5))
# (2) assignment of existing bar forces
# CEM
crv = Curve([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])
pt_3 = Point([Point(15, 0, 10), Point(20, 0, 10), Point(25, 0, 10), Point(30, 0, 10), Point(35, 0, 10), Point(40, 0, 10)])
pt_4 = Point([Point(10, 0, 10), Point(45, 0, 10)])
line = Line([Line((10, 0, 5), (15, 0, 10)), Line((15, 0, 10), (20, 0, 5)), Line((20, 0, 5), (25, 0, 10)), Line((25, 0, 10), (30, 0, 5)), Line((30, 0, 5), (20, 0, 5)), Line((20, 0, 5), (10, 0, 5)), Line((25, 0, 10), (15, 0, 10))])
# Phoenix3D
# (1) default use case
line_2 = Line([Line((10, 0, 5), (15, 0, 10)), Line((15, 0, 10), (20, 0, 5)), Line((20, 0, 5), (25, 0, 10)), Line((25, 0, 10), (30, 0, 5)), Line((30, 0, 5), (20, 0, 5)), Line((20, 0, 5), (10, 0, 5)), Line((25, 0, 10), (15, 0, 10))])
pt_5 = Point([Point(10, 0, 5), Point(30, 0, 5)])
crv_2 = Curve(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)
# (3) geometric assignment
steel = Steel(
    D_kg_m3=7850,
    YoungsModulus=210000,
    PoissonRatio=0.3,
    TensionStrength=235,
    CompressionStrength=235,
    MaterialSafetyFactor=1,
    MaterialSafetyFactorForStability=1.1)
cs = CircularSection(Diameter_mm=100)
vec = VectorXYZ(XComponent=Slider(0, range=-1..1), YComponent=0, ZComponent=Slider(-0.45, range=-1..1))  # -> Vector, Length
Y = UnitY(Factor=1)
pl = Pointload(Point=pt_2, Forces_MN=vec.Vector, ScaleLoad=1)
# - designing structures through reuse -
steel_2 = Steel(
    D_kg_m3=7850,
    YoungsModulus=210000,
    PoissonRatio=0.3,
    TensionStrength=235,
    CompressionStrength=235,
    MaterialSafetyFactor=1,
    MaterialSafetyFactorForStability=1.1)
cem_deviation_2_0 = CEM_Deviation_20(DeviationEdge=crv_2, DeviationMagn=Slider(-2, range=-10..10))
cs_2 = CircularSection(Diameter_mm=100)
cem_load_2_0 = CEM_Load_20(PointLoad=pt_3, LoadMagnZ=Slider(-1, range=-1..1))
cem_trail_2_0 = CEM_Trail_20(TrailEdge=crv, TrailLen=Slider(-5, range=-10..10))
cem_support_2_0 = CEM_Support_20(Support=pt_4)
Y_2 = UnitY(Factor=1)
bar_truss = Bar(Lines=graft(line), Material=steel, CrossSection=cs, Normal=Y)
toggle = BooleanToggle(False)
bar_truss_2 = Bar(Lines=line_2, Material=steel_2, CrossSection=cs_2, Normal=Y_2)
loadcase = LoadCase(Name="LC1", PointLoads=pl, SelfWeightFactor=1)
sp = Support(Point=pt_5, FixTX=True, FixTY=True, FixTZ=True, ScaleSupport=1)
sp_2 = Support(Point=pt, FixTX=toggle, FixTY=True, FixTZ=toggle, ScaleSupport=1)
vec_2 = VectorXYZ(XComponent=0, YComponent=0, ZComponent=0)  # -> Vector, Length
lng = ListLength(List=bar_truss)
cem_build_topology_2_0 = CEM_Build_Topology_20(T=cem_trail_2_0, L=cem_load_2_0, D=cem_deviation_2_0, S=cem_support_2_0)
steel_3 = Steel(
    D_kg_m3=7850,
    YoungsModulus=210000,
    PoissonRatio=0.3,
    TensionStrength=235,
    CompressionStrength=235,
    MaterialSafetyFactor=1,
    MaterialSafetyFactorForStability=1.1)
dup = DuplicateData(Data=vec_2.Vector, Number=lng, Order=True)  # -> simplify(Data)
cem_calculate_structure_2_0 = CEM_Calculate_Structure_20(MarshallingSignalParameter=cem_build_topology_2_0)
panel = Panel("""80
400""")
setbarforces = SetBarForces(Member=simplify(bar_truss), LoadCaseName="LC1", Force=dup)  # -> flatten(Member)
upe = UPESection(Size=panel)
cluster = Cluster(M=cem_calculate_structure_2_0)  # -> R_2, R, i
steel_4 = Steel(
    D_kg_m3=7850,
    YoungsModulus=210000,
    PoissonRatio=0.3,
    TensionStrength=235,
    CompressionStrength=235,
    MaterialSafetyFactor=1,
    MaterialSafetyFactorForStability=1.1)
newelement = NewElement(Material=steel_3, CrossSection=upe, Name="NEW")
reused_element = ReusedElement(
    Material=steel_3,
    CrossSection=upe,
    Length=Slider(10, range=0..10),
    AmountOfElements=Slider(3, range=0..10),
    ElementsCanBeCut=True,
    Name="REUSED")
S = Structure(Members=setbarforces)
upe_2 = UPESection(Size="400")
stock = Stock(ElementsReuseAndNew=[reused_element, newelement], OrderElements=0)
division = Division(A=cluster.R, B=Slider(10, range=0..1000))
newelement_2 = NewElement(Material=steel_4, CrossSection=upe_2, Name="NEW")
reused_element_2 = ReusedElement(
    Material=steel_4,
    CrossSection=upe_2,
    Length=Slider(10, range=0..10),
    AmountOfElements=Slider(3, range=0..10),
    ElementsCanBeCut=True,
    Name="REUSED")
list = ValueList({"MinStructureMass": 0, "MinStockMass": 1, "MinWaste": 2, "MinLCA": 3}, selected="MinLCA")
S_2 = Structure(Members=bar_truss_2, Supports=[sp, sp_2], LoadCases=loadcase)
stock_2 = Stock(ElementsReuseAndNew=[reused_element_2, newelement_2], OrderElements=0)
best_fit = BestFit(Structure=S, Stock=stock, Objective=list, LoadCases="LC1", PromoteFirstPart=False, Iterations=1, RunFEA=Toggle(False))  # -> Structure, Stock
crv_3 = Curve(cluster.R_2)
data = Data(division)
list_2 = ValueList({"MinStructureMass": 0, "MinStockMass": 1, "MinWaste": 2, "MinLCA": 3}, selected="MinLCA")
list_3 = ValueList({"Blank": 0, "Forces": 1, "Utilization": 2, "Reuse New": 3, "Mass": 4, "Environmental Impact": 5}, selected="Reuse New")
list_4 = ValueList({"Full Stock Blank": 0, "Full Stock": 1, "Used Stock": 2}, selected="Full Stock")
best_fit_2 = BestFit(
    Structure=S_2,
    Stock=stock_2,
    Objective=list_2,
    LoadCases="LC1",
    PromoteFirstPart=False,
    Iterations="10",
    RunFEA=Toggle(True))  # -> Structure, Stock
steel_5 = Steel(
    D_kg_m3=7850,
    YoungsModulus=210000,
    PoissonRatio=0.3,
    TensionStrength=235,
    CompressionStrength=235,
    MaterialSafetyFactor=1,
    MaterialSafetyFactorForStability=1.1)
steel_6 = Steel(
    D_kg_m3=7850,
    YoungsModulus=210000,
    PoissonRatio=0.3,
    TensionStrength=235,
    CompressionStrength=235,
    MaterialSafetyFactor=1,
    MaterialSafetyFactorForStability=1.1)
cs_3 = CircularSection(Diameter_mm=100)
Y_3 = UnitY(Factor=1)
disp_struct = DisplayStructure(Structure=best_fit.Structure, DisplayResultsType=list_3, LoadCase="LC1", DisplacementScale=Slider(50, range=0..100))
disp_stock = DisplayStock(
    Structure=best_fit.Structure,
    Stock=best_fit.Stock,
    Plane=Plane(origin=(0, 0, 0), x=(0, 0, 0), y=(0, 0, 0)),
    SpacingVector=Vector(1, 1, 0),
    StockType=list_4,
    ResultsType=list_3,
    LoadCase="LC1")  # -> CutOff, UsedElements
disp_res = DisplayResults(Stucture=best_fit.Structure, ShowResultsOnStructure=Toggle(False), LoadCase="LC1")  # -> OptimizationResults, Utilization, NormalForces
panel_2 = Panel("""20
40
80""")
cs_4 = CircularSection(Diameter_mm=panel_2)
list_5 = ValueList({"Blank": 0, "Forces": 1, "Utilization": 2, "Reuse New": 3, "Mass": 4, "Environmental Impact": 5}, selected="Reuse New")
bar_truss_3 = Bar(Lines=graft(crv_3), Material=steel_6, CrossSection=cs_3, Normal=Y_3)
list_6 = ValueList({"Full Stock Blank": 0, "Full Stock": 1, "Used Stock": 2}, selected="Full Stock")
panel_3 = Panel(disp_res.OptimizationResults)
newelement_3 = NewElement(Material=steel_5, CrossSection=cs_4, Name="NEW")
reused_element_3 = ReusedElement(
    Material=steel_5,
    CrossSection=cs_4,
    Length=Slider(10, range=0..10),
    AmountOfElements=Slider(3, range=0..10),
    ElementsCanBeCut=True,
    Name="REUSED")
disp_struct_2 = DisplayStructure(Structure=best_fit_2.Structure, DisplayResultsType=list_5, LoadCase="LC1", DisplacementScale=Slider(50, range=0..100))
disp_stock_2 = DisplayStock(
    Structure=best_fit_2.Structure,
    Stock=best_fit_2.Stock,
    Plane=Plane(origin=(0, 0, 0), x=(0, 0, 0), y=(0, 0, 0)),
    SpacingVector=Vector(1, 1, 0),
    StockType=list_6,
    ResultsType=list_5,
    LoadCase="LC1")  # -> CutOff, UsedElements
disp_res_2 = DisplayResults(Stucture=best_fit_2.Structure, ShowResultsOnStructure=Toggle(False), LoadCase="LC1")  # -> OptimizationResults, Utilization, NormalForces
setbarforces_2 = SetBarForces(Member=bar_truss_3, LoadCaseName="LC1", Force=graft(data))  # -> flatten(Member)
stock_3 = Stock(ElementsReuseAndNew=[reused_element_3, newelement_3], OrderElements=0)
panel_4 = Panel(disp_res_2.OptimizationResults)
S_3 = Structure(Members=setbarforces_2)
list_7 = ValueList({"MinStructureMass": 0, "MinStockMass": 1, "MinWaste": 2, "MinLCA": 3}, selected="MinLCA")
best_fit_3 = BestFit(
    Structure=S_3,
    Stock=stock_3,
    Objective=list_7,
    LoadCases="LC1",
    PromoteFirstPart=False,
    Iterations="10",
    RunFEA=Toggle(False))  # -> Structure, Stock
list_8 = ValueList({"Blank": 0, "Forces": 1, "Utilization": 2, "Reuse New": 3, "Mass": 4, "Environmental Impact": 5}, selected="Reuse New")
list_9 = ValueList({"Full Stock Blank": 0, "Full Stock": 1, "Used Stock": 2}, selected="Full Stock")
disp_struct_3 = DisplayStructure(Structure=best_fit_3.Structure, DisplayResultsType=list_8, LoadCase="LC1", DisplacementScale=Slider(50, range=0..100))
disp_stock_3 = DisplayStock(
    Structure=best_fit_3.Structure,
    Stock=best_fit_3.Stock,
    Plane=Plane(origin=(0, 0, 0), x=(0, 0, 0), y=(0, 0, 0)),
    SpacingVector=Vector(1, 1, 0),
    StockType=list_9,
    ResultsType=list_8,
    LoadCase="LC1")  # -> CutOff, UsedElements
disp_res_3 = DisplayResults(Stucture=best_fit_3.Structure, ShowResultsOnStructure=Toggle(True), LoadCase="LC1")  # -> OptimizationResults, Utilization, NormalForces
panel_5 = Panel(disp_res_3.OptimizationResults)

# ==== cluster Cluster
M = ClusterInput()
cem_extract_structure_2_0 = CEM_Extract_Structure_20(M=M)  # -> Nodes, NodesID, Trails, TrailsID, TrailsCol, TrailsMag, Deviations, DeviationsID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
pdecon = Deconstruct(Point=cem_extract_structure_2_0.Nodes)  # -> XComponent, YComponent, ZComponent
sort = SortList(Keys=pdecon.XComponent, ValuesA=cem_extract_structure_2_0.Nodes)  # -> Keys, ValuesA
panel = Panel("""-1
0""")
pipe = Pipe(
    Curve=[cem_extract_structure_2_0.Trails, cem_extract_structure_2_0.Deviations, cem_extract_structure_2_0.ExternalForces],
    Radius=Slider(0.03, range=0..1),
    Caps=0)  # -> flatten(Pipe)
item = ListItem(List=sort.ValuesA, Index=panel, Wrap=True)
preview = CustomPreview(
    Geometry=pipe,
    Material=[cem_extract_structure_2_0.TrailsCol, cem_extract_structure_2_0.DeviationsCol, cem_extract_structure_2_0.ExternalForcesCol])
i = ClusterOutput(item)
merge = Merge(Data1=cem_extract_structure_2_0.TrailsMag, Data2=cem_extract_structure_2_0.DeviationsMag)
merge_2 = Merge(Data1=cem_extract_structure_2_0.Trails, Data2=cem_extract_structure_2_0.Deviations)
R = ClusterOutput(merge)
R_2 = ClusterOutput(merge_2)
